# Grasshopper definition TEST.gh (Grasshopper 1.0.4)
# plug-ins: Fractals
# https://www.praneetmathur.me
# contact@praneetmathur.me
# Praneet Mathur

number_slider = Slider(0, range=0..100)
construct_point = ConstructPoint(XCoordinate=number_slider, YCoordinate=number_slider, ZCoordinate=0)
construct_point_2 = ConstructPoint(XCoordinate=Slider(0, range=0..100), YCoordinate=Slider(250, range=0..1000), ZCoordinate=0)
construct_point_3 = ConstructPoint(XCoordinate=Slider(600, range=0..1000), YCoordinate=Slider(400, range=0..1000), ZCoordinate=0)
number_slider_2 = Slider(200, range=0..10000)

diffusion_limited_aggregation = DiffusionLimitedAggregation(
    NumberOfIterations=Slider(10000, range=0..10000),
    GenerationPoint=construct_point,
    Multiplier=Slider(2, range=0..100),
    CanvasHeight=number_slider_2,
    CanvasWidth=number_slider_2,
    LoopOnCanvasEdge=Toggle(False))
l_systems_tutrle = LSystemsTutrle(
    GenerationPoint=construct_point_2,
    GenerationCode="F+F-F+F+f-F+",
    Iterations=Slider(100, range=0..10000),
    Angle=Slider(15, range=0..100),
    StepLength=Slider(100, range=0..100))  # -> Points, Lines
vogel_sunflower = VogelSunflower(NumberOfIterations=Slider(1500, range=0..10000), GenerationPoint=construct_point_3, Degree=Slider(6, range=0..100))  # -> Points, Radius

point = Point(diffusion_limited_aggregation)
unit_z = UnitZ(Factor=1)
polyline = PolyLine(Vertices=point, Closed=False)
point_2 = Point(l_systems_tutrle.Points)
line = Line(l_systems_tutrle.Lines)
circle_cnr = CircleCNR(Center=vogel_sunflower.Points, Normal=unit_z, Radius=vogel_sunflower.Radius)
